% Requirement links of breathRateCalc.m (R2023b)

% line 1 implements ecgAppReq.slreqx#7
function [breathRate, u] = breathRateCalc(in, Fs)

% lines 3-5 implements ecgAppReq.slreqx#11
[c, l] = wavedec(in, 8, 'sym8'); 
c(1:l(1)) = 0; 
c(l(1)+l(2)+2:end) = 0;

% line 11 implements ecgAppReq.slreqx#10
[~, idx] = findpeaks(u, 'MinPeakDistance', minPeakSamples);