% Requirement links of heartRateCalc.m (R2023a)

% line 1 implements ecgAppReq.slreqx#12
function [heartRate, u] = heartRateCalc(u, Fs)

% line 7 implements ecgAppReq.slreqx#13
minPeakSamples = 50;

% line 8 implements ecgAppReq.slreqx#14
minPeakHeight = 0.3;