% Requirement links of breathRateTest.m (R2023a)

% line 1 verifies ecgAppReq.slreqx#7
classdef breathRateTest < matlab.unittest.TestCase

% line 17 verifies ecgAppReq.slreqx#11
% line 17 verifies ecgAppReq.slreqx#10
        function testValidRate(testCase, patientId)

% lines 24-25 verifies ecgAppReq.slreqx#8
            verifyGreaterThan(testCase, breathRate, 8);
            verifyLessThan(testCase, breathRate, 25);