% Requirement links of ecgClassifyTest.m (R2024a)

% line 1 verifies ecgAppReq.slreqx#17
classdef ecgClassifyTest < matlab.unittest.TestCase

% line 18 verifies ecgAppReq.slreqx#19
        function validClassifyTest(testCase, patientId)

% lines 29-30 verifies ecgAppReq.slreqx#22
            verifyEqual(testCase, classOut, 'ARR')
            verifyGreaterThanOrEqual(testCase, score, 0.999)