% Requirement links of heartRateTest.m (R2023a)

% line 1 verifies ecgAppReq.slreqx#12
classdef heartRateTest < matlab.unittest.TestCase

% line 17 verifies ecgAppReq.slreqx#13
% line 17 verifies ecgAppReq.slreqx#14
        function testHeartRate(testCase, patientId)

% lines 24-25 verifies ecgAppReq.slreqx#16
            verifyGreaterThan(testCase, heartRate, 50);
            verifyLessThan(testCase, heartRate, 200);